vi "Temperature Monitor.gviweb"   [LabVIEW NXG 3.1.0]
panel controls:
  "High Limit": f64 = 90
  "Low Limit": f64 = 75
  "Sites": i32 = -1
panel indicators:
  "Temperature (F)": f64
  "settings icon": string
  "Alarm": bool
  "thermometer icon": string
  "location icon": string
  "Temperature History": f64[][]
uses:
  Leaflet::Map::Create Map.gviweb
  Application::subVIs::Create Map Markers.gviweb
  Application::subVIs::Limit Test.gviweb
  Leaflet::Marker::Show Marker Popup.gviweb
  Leaflet::Map::Destroy Map.gviweb
diagram:
  w1 = ["Station1.Temperature", "Station2.Temperature", "Station3.Temperature", "Station4.Temperature"]
  for {
    w2 = each element of w1
    w3 = w7
    w4 = w8
    append w9 to w5
    w6 = w10
  }
  call "Create Map.gviweb"(selector=".map-placeholder") -> (map refnum=w11, error out=w12)
  call "Create Map Markers.gviweb"(map refnum=w11, error in=w12) -> (map refnum out=w13, marker refnums=w14, error out=w15)
  s1 = uninitialised  # shift register
  s2 = w13  # shift register
  while {
    event (timeout = 100) {
      on Timeout {
        for {
          w20 = each element of w5
          w16 = w21
          append w22 to w17
        }
        call "Limit Test.gviweb"(Temperatures=w17, High Limit=$"High Limit", Low Limit=$"Low Limit") -> (Alarm=w23)
        $Alarm <- w23
        Build Array(w17, $"High Limit", $"Low Limit") -> w24
        Build Array(w24) -> w25
        $"Temperature History" <- w25
        w18 = s2
        w19 = w15
      }
      on "Sites" Value changed {
        Is Equal(x=$Sites, y=-1) -> w26
        case (w26) {
          frame True {
            # If site number
            # is -1, use default
            # temperature values
            w27 = 0
          }
          frame False {
            Array Index(array=s1) -> (out0[$Sites]=w27)
            Array Index(array=w14) -> (out0[$Sites]=w28)
            call "Show Marker Popup.gviweb"(marker refnum=w28)
          }
        }
        $"Temperature (F)" <- w27
        w16 = w6
        w17 = s1
        w18 = s2
        w19 = w15
      }
    }
    next s1 = w17
    next s2 = w18
    stop if FALSE
  }
  for (after w5) (after w16) {
  }
  call "Destroy Map.gviweb"(map refnum=s2, error in=w19)
