vi "Create Map Markers.gviweb"   [LabVIEW NXG 3.1.0]
inputs:
  "map refnum": "map refnum.gtype"
  "error in": error
outputs:
  "marker refnums": "marker refnum.gtype"[]
  "error out": error
  "map refnum out": "map refnum.gtype"
types:
  "map refnum.gtype" = i32
  "marker refnum.gtype" = i32
uses:
  Leaflet::Marker::Create Marker.gviweb
diagram:
  w1 = [{"latitude"=30.2636, "longitude"=-97.7474, "text"="Water Feed Pump"}, {"latitude"=30.284, "longitude"=-97.7504, "text"="Gas Line"}, {"latitude"=30.2787, "longitude"=-97.7302, "text"="Aerator"}, {"latitude"=30.2741, "longitude"=-97.7743, "text"="Overflow Tank"}]
  s1 = $"map refnum"  # shift register
  s2 = $"error in"  # shift register
  for {
    w2 = each element of w1
    Property Node(instance in=w2) -> ("latitude"=w4, "longitude"=w5, "text"=w6)
    call "Create Marker.gviweb"(text=w6, map refnum=s1, latitude=w4, longitude=w5, error in=s2) -> (marker refnum=w7, error out=w8)
    append w7 to w3
    next s2 = w8
  }
  $"map refnum out" <- s1
  $"marker refnums" <- w3
  $"error out" <- s2
