vi "Limit Test.gviweb"   [LabVIEW NXG 3.1.0]
inputs:
  "Temperatures": f64[], required
  "High Limit": f64 = 85, required
  "Low Limit": f64 = 75, required
outputs:
  "Alarm": bool
diagram:
  for {
    w1 = each element of $Temperatures
    Is Greater(x=w1, y=$"High Limit") -> w3
    Is Less(x=w1, y=$"Low Limit") -> w4
    Logical Or(w3, w4) -> w5
    append w5 to w2
  }
  Or Array Elements(Boolean array=w2) -> (logical OR=w6)
  $Alarm <- w6
